% Simulink data dictionary Three_Tank_V1.sldd

Bus_CISO = Simulink.Bus()
  Parameter: double[8]
  Valve_Tank_Left_Middle: Bus: Valve_Bus_CISO
  Valve_Tank_Middle_Right: Bus: Valve_Bus_CISO
  Valve_Tank_Right_Reservoir: Bus: Valve_Bus_CISO
  Valve_Leak_Tank_Left: Bus: Valve_Bus_CISO
  Valve_Leak_Tank_Right: Bus: Valve_Bus_CISO
  Valve_Leak_Tank_Middle: Bus: Valve_Bus_CISO
  Level_Tank_Left: double
  Level_Tank_Right: double
  Level_Tank_Middle: double

Bus_COSI = Simulink.Bus()
  Parameter: double[8]
  Pump_Tank_Left: double
  Pump_Tank_Right: double
  Valve_Tank_Left_Middle: Bus: Valve_Bus_COSI
  Valve_Tank_Middle_Right: Bus: Valve_Bus_COSI
  Valve_Tank_Right_Reservoir: Bus: Valve_Bus_COSI
  Valve_Leak_Tank_Left: Bus: Valve_Bus_COSI
  Valve_Leak_Tank_Right: Bus: Valve_Bus_COSI
  Valve_Leak_Tank_Middle: Bus: Valve_Bus_COSI

V_REAL_TIME = Simulink.Variant(Condition="VARIANT == 2")
V_SIMULATION = Simulink.Variant(Condition="VARIANT == 1")

Valve_Bus_CISO = Simulink.Bus()
  State: Enum: E_Valve_State_CISO
  Position: double
  Closed: boolean
  Opened: boolean

Valve_Bus_COSI = Simulink.Bus()
  State: Enum: E_Valve_State_COSI
  Open: boolean
  Close: boolean

E_Valve_State_CISO = enum(HeaderFile="valve_state_in.h", DefaultValue="In_Between", AddClassNameToEnumNames=true)  % State of valve input...
  In_Between = 0
  Closed = 1
  Opened = 2

E_Valve_State_COSI = enum(HeaderFile="valve_state_out.h", DefaultValue="Off", AddClassNameToEnumNames=true)  % State of valve output...
  Off = 0
  Close = 1
  Open = 2

Sig = Simulink.Signal()
VARIANT = 2